# Dynamo graph Christmas Tree.dyn "TREE" (Dynamo 2.12.0.5650)
# packages: MeshToolkit 3.0.0

# group: Object Importing
string = StringInput("C:\Users\moham\Desktop\Christmas-Tree .obj")
importFile = Autodesk.Dynamo.MeshToolkit.Mesh.ImportFile(fileName=string)
smooth = Autodesk.Dynamo.MeshToolkit.Mesh.Smooth(mesh=importFile)

# group: Refining n Placing
code_block = CodeBlock { P1=Point.ByCoordinates(0,0,0); P2=Point.ByCoordinates(5,0,0); Vector.ByTwoPoints(P1,P2); 90; }
rotate = Autodesk.Dynamo.MeshToolkit.Mesh.Rotate(axis=code_block.out2, degrees=code_block.out3)  # unwired: mesh
code_block_2 = CodeBlock { 0.2; 0.2; 0.2; }
scale = Autodesk.Dynamo.MeshToolkit.Mesh.Scale(mesh=smooth, x=code_block_2.out1, y=code_block_2.out1, z=code_block_2.out1)
translate = Autodesk.Dynamo.MeshToolkit.Mesh.Translate(mesh=scale, x=code_block_2.out2, z=code_block_2.out0)

# group: Coloring
color_palette = ColorPalette({R: 46, G: 139, B: 87, A: 255})
byMeshColor = Autodesk.Dynamo.MeshToolkit.Display.MeshDisplay.ByMeshColor(mesh=translate, meshColoring=color_palette)
watch_3d = Watch3D(byMeshColor)
